# Grasshopper definition main.gh (Grasshopper 1.0.8)

list = ValueList({"1168010800100880001", "1168010800100880007", "1168010800100880008", "1168010800100880009", "1168010800100880011"}, selected="1168010800100880001")
path = FilePath("C:\Users\bsh96\Documents\GitHub\HeightLimitCalculation\data\Parcels.shp")
py3 = Python3Script(script=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, shp_path=path, pnu=list)  # -> out, target_lot_region, other_lot_regions; inputs pnu: String; unedited script template
py3_2 = Python3Script()  # -> out, a; unedited script template
boundary = BoundarySurfaces(Edges=py3.target_lot_region)
py3_3 = Python3Script(target_lot_region=py3.target_lot_region, other_lot_regions=py3.other_lot_regions)  # -> out, height_limit; inputs target_lot_region: Curve, other_lot_regions: list of Curve; unedited script template
panel = Panel(py3.out)
